# Grasshopper definition PicoGH.ghx (Grasshopper 1.0.7)
# plug-ins: PicoGH

brep = Brep(<brep referenced from the Rhino model>)
brep_2 = Brep(<brep referenced from the Rhino model>)
mesh = Mesh(brep)
mesh_2 = Mesh(brep_2)
munion = MeshUnion(Meshes=[mesh, mesh_2])
pt = Point(Point(0, 0, -40))
mesh_union = PicoGHMeshUnion(Mesh1=mesh, Mesh2=mesh_2)
pt_2 = Point(Point(0, 0, -20))
move = Move(Geometry=munion, Motion=pt)  # -> Geometry, Transform
move_2 = Move(Geometry=mesh_union, Motion=pt_2)  # -> Geometry, Transform
mesh_3 = Mesh(move.Geometry)
mesh_4 = Mesh(move_2.Geometry)
